# Grasshopper definition equad.ghx (Grasshopper 1.0.7)
# plug-ins: Human, Weaverbird, Kangaroo2 Components

number_slider = Slider(9, range=0..100)
number_slider_2 = Slider(18, range=0..100)
pipeline = GeometryPipeline(
    GroupByLayer=False,
    GroupByType=False,
    IncludeHidden=True,
    IncludeLocked=True,
    LayerFilter="supports",
    NameFilter="*",
    SublayerFiltering=True,
    TypeFilter=1)
number_slider_3 = Slider(14, range=0..100)  # disabled
python = GhPythonScript()  # -> out, mesh; disabled
# ---------- python: Python ----------
__author__ = "Rafael Pastrana"

import compas
from compas.datastructures import Mesh


mesh = Mesh.from_obj(compas.get('faces.obj'))
# ---------- end python ----------
python_2 = GhPythonScript()  # -> out, ghmesh; disabled
# ---------- python_2: Python ----------
__author__ = "arpj"


from compas_ghpython.artists import MeshArtist

artist = MeshArtist(mesh)


ghmesh = artist.draw_mesh()
# ---------- end python_2 ----------
python_3 = GhPythonScript(mesh=python.mesh)  # -> out, mesh; disabled
# ---------- python_3: Python ----------
__author__ = "arpj"


from compas.datastructures import mesh_subdivide

mesh = mesh_subdivide(mesh, k=1)
# ---------- end python_3 ----------
pt = Point(pipeline)
crv = Curve(<curve referenced from the Rhino model>)
num = Number(number_slider)
num_2 = Number(number_slider)
merge = Merge(Data1=number_slider_3, Data2=Slider(10, range=0..100), Data3=Slider(33, range=0..100))
num_3 = Number(Slider(0, range=-10..20))
crv_2 = Curve(crv)
num_4 = Number(num)
num_5 = Number(num_2)
boundary = BoundarySurfaces(Edges=crv_2)
sdivide = DivideSurface(Surface=boundary, UCount=num_4, VCount=num_5)  # -> simplify(Points), Normals, Parameters
pt_2 = Point(sdivide.Points)
pt_3 = Point(pt_2)
flip = FlipMatrix(Data=sdivide.Points)
pline = PolyLine(Vertices=sdivide.Points, Closed=False)
pline_2 = PolyLine(Vertices=flip, Closed=False)
relitem = RelativeItem(Tree=pt_3, Offset="{1}[1]", WrapPaths=False, WrapItems=False)  # -> ItemA, ItemB
relitem_2 = RelativeItem(Tree=pt_3, Offset="{-1}[1]", WrapPaths=False, WrapItems=False)  # -> ItemA, ItemB
entwine = Entwine(Branch00=pline_2, Branch01=pline, FlattenInputs=True)
ln = Line(StartPoint=relitem_2.ItemA, EndPoint=relitem_2.ItemB)
ln_2 = Line(StartPoint=relitem.ItemA, EndPoint=relitem.ItemB)
explode = Explode(Curve=entwine, Recursive=True)  # -> Segments, Vertices
flip_2 = FlipCurve(Curve=ln_2)  # -> Curve, Flag
entwine_2 = Entwine(Branch00=ln, Branch01=flip_2.Curve, FlattenInputs=True)
flatten = FlattenTree(Tree=explode.Segments, Path="{0}")
shatter = Shatter(Curve=reparameterize(entwine_2), Parameters="0.5")
crv_3 = Curve(entwine)
crv_4 = Curve(crv_3)
item = ListItem(List=crv_4, Index=0, Wrap=True)  # -> Item1, Item
merge_2 = Merge(Data1=item.Item1, Data2=item.Item)
explode_2 = Explode(Curve=merge_2, Recursive=True)  # -> Segments, Vertices
crv_5 = Curve(explode_2.Segments)
crv_6 = Curve(crv_5)
crv_7 = Curve(flatten)
entwine_3 = Entwine(Branch00=shatter, Branch01=crv_6, FlattenInputs=True)
explode_3 = Explode(Curve=entwine_3, Recursive=True)  # -> Segments, Vertices
end = EndPoints(Curve=explode_3.Segments)  # -> Start, End
ln_3 = Line(StartPoint=end.Start, EndPoint=end.End)
flatten_2 = FlattenTree(Tree=ln_3, Path="{0}")
crv_8 = Curve(flatten_2)
crv_9 = Curve(crv_7)
crv_10 = Curve(crv_8)
wbweave = WeaverbirdsMeshFromLinesWeaveBack(Lines=crv_8, MaximumValence=4)
wbweave_2 = WeaverbirdsMeshFromLinesWeaveBack(Lines=crv_9, MaximumValence=4)
python_4 = GhPythonScript(lines=crv_10)  # -> out, mesh, ghmesh; inputs lines: list
# ---------- python_4: Python ----------
from compas_rhino.utilities import get_line_coordinates
from compas.datastructures import Mesh
from compas_ghpython.artists import MeshArtist


mesh = Mesh.from_lines(get_line_coordinates(lines), delete_boundary_face=True)
a = MeshArtist(mesh)
ghmesh = a.draw_faces()
# ---------- end python_4 ----------
clean = CombineClean(Meshes=wbweave_2)
wbmidedge = WeaverbirdsMidedgeSubdivision(MeshCurves=clean, Level=1, SmoothNakedEdges=0)
mesh = Mesh(python_4.ghmesh)
data = Data(python_4.mesh)
explode_4 = Explode(Curve=wbmidedge, Recursive=True)  # -> flatten(Segments), Vertices
dupln = RemoveDuplicateLines(Lines=explode_4.Segments, Tolerance=0.01)
crv_11 = Curve(dupln)
crv_12 = Curve(crv_11)
python_5 = GhPythonScript(lines=crv_12)  # -> out, mesh, ghmesh; inputs lines: list; same code as python_4
wbweave_3 = WeaverbirdsMeshFromLinesWeaveBack(Lines=crv_12, MaximumValence=4)
wbjoin = WeaverbirdsJoinMeshesAndWeld(Mesh=python_5.ghmesh, Weld=False)
mesh_2 = Mesh(wbweave_3)
mesh_3 = Mesh(wbjoin)
data_2 = Data(python_5.mesh)
num_6 = Number(num_3)
mesh_4 = Mesh(mesh_2)
pt_4 = Point(pt)
mesh_5 = Mesh(wbweave_3)
data_3 = Data(data_2)
wbvertices = WeaverbirdsVerticesComponent(MeshClosedPolylinesGroup=mesh_5, Weld=True)
cp = ClosestPoint(Point=pt_4, Cloud=wbvertices)  # -> ClosestPoint, CPIndex, Distance
python_6 = GhPythonScript()  # -> out, dva, dea
# ---------- python_6: Python ----------
__author__ = "Rafael Pastrana"


import scriptcontext as sc


dva = {
    'is_fixed': False,
    'x': 0.0,
    'y': 0.0,
    'z': 0.0,
    'px': 0.0,  # x component of point load at vertices
    'py': 0.0,  # y component of point load at vertices
    'pz': 10.0,  # z component of point load at vertices
    'rx': 0.0,
    'ry': 0.0,
    'rz': 0.0,
}

dea = {
    'qpre': 10.0,  # prescribed force densities
    'fpre': 0.0,  # prescribed edge forces
    'lpre': 0.0,  # prescribed edge lengths
    'linit': 0.0,  # initial edge length
    'E': 10.0,  # initial edge length (kN/mm2 => GPa)
    'radius': 2.5, # global initial cable radius (mm)
}

sc.sticky['dva'] = dva
sc.sticky['dea'] = dea
# ---------- end python_6 ----------
python_7 = GhPythonScript(mesh=data_3)  # -> out, points; disabled
# ---------- python_7: Python ----------
__author__ = "arpj"


points = []
for key in mesh.vertices():
    if mesh.vertex_degree(key) == 2:
        xyz = mesh.vertex_coordinates(key)
        points.append(xyz)
# ---------- end python_7 ----------
python_8 = GhPythonScript(mesh=data_3)  # -> out, points
# ---------- python_8: Python ----------
__author__ = "arpj"


points = []
for key in mesh.vertices_on_boundary():
    print(key)
    xyz = mesh.vertex_coordinates(key)
    points.append(xyz)
# ---------- end python_8 ----------
python_9 = GhPythonScript(mesh=data_3, ghpoints=cp.ClosestPoint)  # -> out, points; inputs ghpoints: list
# ---------- python_9: Python ----------
__author__ = "arpj"


from compas_rhino.utilities import get_point_coordinates
from compas.utilities import geometric_key

ghpoints = get_point_coordinates(ghpoints)

gkey_key = mesh.gkey_key()


points = []
for ghpoint in ghpoints:
    pt = gkey_key[geometric_key(ghpoint)]
    points.append(ghpoint)
# ---------- end python_9 ----------
data_4 = Data(python_6.dva)
data_5 = Data(python_6.dea)
merge_3 = Merge(Data1=python_7.points, Data2=python_8.points, Data3=python_9.points)  # -> flatten(Result)
panel = Panel(python_9.out)
python_10 = GhPythonScript(ghmesh=mesh_4, points=merge_3, projected=python_9.points, my_z=num_6)  # -> out, mesh; inputs points: list, projected: list
# ---------- python_10: Python ----------
__author__ = "Rafael Pastrana"


import scriptcontext as sc

from copy import deepcopy
from compas.datastructures import Mesh

from compas.utilities import geometric_key

from compas_rhino.helpers import mesh_from_guid
from compas_ghpython.artists import MeshArtist

# ==============================================================================
# Call Proxy Locally
# ==============================================================================


numerical = sc.sticky['numerical']
dr_numpy = numerical.dr_numpy

dea = sc.sticky['dea']
dva = sc.sticky['dva']

# mesh builder
mesh = mesh_from_guid(Mesh, ghmesh)

# update attributes
mesh.update_default_vertex_attributes(dva)
mesh.update_default_edge_attributes(dea)

# fix vertices
gkey_key = mesh.gkey_key()
projected = [geometric_key(pt) for pt in projected]

for point in points:
    gkey = geometric_key(point)
    vkey = gkey_key[gkey]
    mesh.set_vertex_attribute(vkey, 'is_fixed', True)
    if gkey in projected:
       mesh.set_vertex_attribute(vkey, 'z', my_z)
        
        

# query attributes
k_i = mesh.key_index()
vertices = mesh.get_vertices_attributes(('x', 'y', 'z'))
edges = [(k_i[u], k_i[v]) for u, v in mesh.edges()]
fixed = [k_i[key] for key in mesh.vertices_where({'is_fixed': True})]
loads = mesh.get_vertices_attributes(('px', 'py', 'pz'))
qpre = mesh.get_edges_attribute('qpre')
fpre = mesh.get_edges_attribute('fpre')
lpre = mesh.get_edges_attribute('lpre')
linit = mesh.get_edges_attribute('linit')
E = mesh.get_edges_attribute('E')
radius = mesh.get_edges_attribute('radius')

# carry out dynamic relaxation with numpy

xyz, q, f, l, r = dr_numpy(vertices,
                           edges,
                           fixed,
                           loads,
                           qpre,
                           fpre,
                           lpre,
                           linit,
                           E,
                           radius,
                           kmax=100,
                           callback=None
                           )

# update vertex coordinates
for key, attr in mesh.vertices(True):
    index = k_i[key]
    attr['x'] = xyz[index][0]
    attr['y'] = xyz[index][1]
    attr['z'] = xyz[index][2]
        
# update edges' force and length attributes 
for index, (u, v, attr) in enumerate(mesh.edges(True)):
    attr['f'] = f[index]
    attr['l'] = l[index]
# ---------- end python_10 ----------
data_6 = Data(python_10.mesh)
data_7 = Data(data_6)
data_8 = Data(data_6)
python_11 = GhPythonScript(mesh=data_7)  # -> out, vertices, edges, faces
# ---------- python_11: Python ----------
__author__ = "Rafael Pastrana"

from compas_ghpython.artists import MeshArtist


# ==============================================================================
# Visualize
# ==============================================================================

artist = MeshArtist(mesh)

# vertices = artist.draw_vertices()
edges = artist.draw_edges()
faces = artist.draw_faces()
mesh = artist.draw_mesh()
# ---------- end python_11 ----------
python_12 = GhPythonScript(mesh=data_8)  # -> out, q, forces, radius
# ---------- python_12: Python ----------
forces = [attr['f'][0] for u , v, attr in mesh.edges(True)]
# ---------- end python_12 ----------
panel_2 = Panel(python_10.out)
num_7 = Number(python_12.q)
num_8 = Number(python_12.radius)
num_9 = Number(python_12.forces)
crv_13 = Curve(python_11.edges)
mesh_6 = Mesh(python_11.faces)
pt_5 = Point(python_11.vertices)
num_10 = Number(num_9)
crv_14 = Curve(crv_13)
end_2 = EndPoints(Curve=crv_14)  # -> Start, End
python_13 = GhPythonScript(data=num_10)  # -> out, colors, colors_bar; inputs data: list
# ---------- python_13: Python ----------
import rhinoscriptsyntax as rs
from compas.utilities import i_to_rgb


dmin = min(data)
dmax = max(data)

print(dmin, dmax)
colors = [rs.CreateColor(i_to_rgb(value / dmax)) for value in data]
colors_bar = [rs.CreateColor(i_to_rgb((num * 0.10 * dmax))) for num in range(int(dmin), int(dmax), 10)]
# ---------- end python_13 ----------
duppt = RemoveDuplicatePts(Points=[end_2.Start, end_2.End], Tolerance=0.01)
pdecon = Deconstruct(Point=duppt)  # -> XComponent, YComponent, ZComponent
colour = Colour(python_13.colors)
crv_15 = Curve(crv_13)
sort = SortList(Keys=pdecon.ZComponent)  # -> reverse(Keys), ValuesA
item_2 = ListItem(List=sort.Keys, Index=0, Wrap=True)
previewlw = CustomPreviewLineweights(Geometry=crv_15, Shader=colour, Thickness="3", Absolute=False)
num_11 = Number(item_2)
num_12 = Number(num_11)
num_13 = Number(num_9)
sort_2 = SortList(Keys=num_13)  # -> Keys, ValuesA
graph = QuickGraph(sort_2.Keys, SortOrder=0)
max_height_m = Panel(num_12)

scale = Slider(7, range=0..10)
Y = Slider(60, range=0..60)
neg = Negative(Value=Y)
X = UnitX(Factor=1)
rad = Radians(Degrees=Slider(0, range=0..100))
rad_2 = Radians(Degrees=Slider(88, range=0..100))
pt_6 = ConstructPoint(XCoordinate=Slider(-10, range=-10..10), YCoordinate=neg, ZCoordinate=Slider(30, range=0..30))
Y_2 = UnitY(Factor=1)
xz = XZPlane(Origin=pt_6)
line = LineSDL(Start=pt_6, Direction=X, Length=1)
rot3d = Rotate3D(Geometry=xz, Angle=rad_2, Center=pt_6, Axis=Vector(0, 0, 1))  # -> Geometry, Transform
rot3d_2 = Rotate3D(Geometry=rot3d.Geometry, Angle=rad, Center=pt_6, Axis=line)  # -> Geometry, Transform
rectangle = Rectangle(Plane=rot3d.Geometry, XSize=Domain(-1, 1), YSize=Domain(-2, 2), Radius=0)  # -> Rectangle, Length
area = Area(Geometry=rectangle.Rectangle)  # -> Area, Centroid
scale_2 = Scale(Geometry=rectangle.Rectangle, Center=area.Centroid, Factor=scale)  # -> Geometry, Transform
crv_16 = Curve(scale_2.Geometry)
num_14 = Number(num_9)
bnd = Bounds(Numbers=num_14)
dedomain = DeconstructDomain(Domain=bnd)  # -> Start, End
range = Range(Domain=bnd, Steps=10)
gradient = Gradient(
    LowerLimit=dedomain.End,
    UpperLimit=dedomain.Start,
    Parameter=range,
    stops=[0: RGB(255, 5, 5), 0.365: RGB(255, 255, 0), 0.66: RGB(0, 200, 255), 1: RGB(0, 34, 255)])  # disabled
eval = Evaluate(F="round(x, 4)", x=range)  # disabled
crv_17 = Curve(crv_16)  # disabled
panel_3 = Panel(" kN")  # disabled
concat = Concatenate(FragmentA=eval, FragmentB=panel_3)  # disabled
legend = Legend(Colour=gradient, Tags=concat, Rectangle=crv_17, LegendType=1)  # disabled
